# Grasshopper definition CrvImporter.gh (Grasshopper 1.0.4)

panel = Panel("""295.000,176.000,0.000
295.890,176.421,0.000
296.731,176.932,0.000
297.523,177.531,0.000
298.268,178.217,0.000
298.967,178.988,0.000
299.621,179.842,0.000
300.230,180.777,0.000
300.796,181.791,0.000
301.320,182.883,0.000
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""")
split = TextSplit(Text=panel, Separators="“,”")
item = ListItem(List=split, Index="0", Wrap=True)
item_2 = ListItem(List=split, Index="1", Wrap=True)
item_3 = ListItem(List=split, Index="2", Wrap=True)
pt = ConstructPoint(XCoordinate=item, YCoordinate=item_2, ZCoordinate=item_3)
pline = PolyLine(Vertices=flatten(pt), Closed=False)
join = JoinCurves(Curves=pline, Preserve=False)
reb = RebuildCurve(Curve=join, Degree=Slider(3, range=0..10), Count=Slider(164, range=0..200), Tangents=False)
crv = Curve(pline)

layer_height = Panel("5.0")
crv_2 = Curve(crv)
simplify = SimplifyCurve(Curve=crv_2, Tolerance=Slider(1, range=0..1), AngleTolerance="pi/64")  # -> Curve, Simplified
num = Number(layer_height)
c_script = CSharpScript(P=simplify.Curve, W=num, H=num, S="7")  # -> out, A; inputs P: Polyline, W: Double, H: Double, S: Int32
# ---------- c_script: C# ----------
    A = MeshPolyline(P, W, H, S);
# ---------- c_script: C# additional code ----------
  Mesh MeshPolyline(Polyline polyline, double W, double H, int segments)
  {
    double width = W / 2;
    double height = H / 2;
    var profile = new List<Point3d>();
    for(int i = 0;i < segments;i++)
    {
      double angle = i * Math.PI * 2 / segments;
      profile.Add(new Point3d(Math.Cos(angle) * width, Math.Sin(angle) * height, 0));
    }

    var points = new List<Point3d>();
    var planes = new List<Plane>();

    for(int i = 0;i < polyline.Count;i++)
    {
      Vector3d vector;
      if (i == 0) vector = polyline[1] - polyline[0];
      else if (i == polyline.Count - 1) vector = polyline[polyline.Count - 1] - polyline[polyline.Count - 2];
      else vector = (polyline[i + 1] - polyline[i]) + (polyline[i] - polyline[i - 1]);

      var plane = new Plane(polyline[i] - Vector3d.ZAxis * height, vector, Vector3d.ZAxis);
      planes.Add(new Plane(plane.Origin, plane.ZAxis, plane.YAxis));
    }

    bool isClosed = Math.Abs(polyline[0].DistanceTo(polyline[polyline.Count - 1])) < RhinoDocument.ModelAbsoluteTolerance;
    if (isClosed) planes.RemoveAt(planes.Count - 1);

    foreach(Plane plane in planes)
    {
      foreach(Point3d point in profile)
        points.Add(plane.PointAt(point.X, point.Y));
    }

    var faces = new List<MeshFace>();

    int count = isClosed ? points.Count : points.Count - segments;

    for(int i = 0;i < count;i++)
    {
      int k = i + 1;
      int j = ((k) % segments == 0) ? k - segments : k;

      int sj = j + segments;
      int si = i + segments;
      if (i >= points.Count - segments)
      {
        sj -= points.Count;
        si -= points.Count;
      }

      faces.Add(new MeshFace(i, j, sj, si));
    }

    Mesh mesh = new Mesh();
    mesh.Vertices.AddVertices(points);
    mesh.Faces.AddFaces(faces);
    mesh.Normals.ComputeNormals();
    return mesh;
  }
# ---------- end c_script ----------
cls = Closed(Curve=crv_2)  # -> Closed, Periodic
c_script_2 = CSharpScript(x=cls.Closed, y=c_script.A)  # -> out, A; inputs x: Boolean, y: Mesh
# ---------- c_script_2: C# ----------
    if (x) y.Flip(true, true, true);
    A = y;
# ---------- end c_script_2 ----------
unweld = UnweldMesh(Mesh=c_script_2.A, Angle="pi/4")
